# Grasshopper definition test.gh (Grasshopper 1.0.7)
# plug-ins: BH.UI.Grasshopper

# ----
# Standard Query
# Apply for access: https://developer.twitter.com/en/apply-for-access
credentials = Credentials(Component="BH.oM.Twitter.Credentials")
searchtweets = SearchTweets(Credentials=credentials, Query="Liverpool", Component="{ .SearchTweets")
explode = Explode(Object=searchtweets, Component="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")  # -> Results, BHoM_Guid, Name, Fragments, Tags, CustomData
explode_2 = Explode(Object=explode.Results, Component="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")  # -> Objects, Name, Tags, BHoM_Guid
explode_3 = Explode(Object=explode_2.Objects, Component="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")  # -> Created_at, Id, Id_str, Text, Truncated, Entities, Metadata, Source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

# ----
# Premium Query
# Apply for access: https://developer.twitter.com/en/apply-for-access
# https://api.twitter.com/1.1/tweets/search/fullarchive/production.json
# QUERY BUILDING SEE:
# https://developer.twitter.com/en/docs/tweets/rules-and-filtering/guides/using-premium-operators
credentials_2 = Credentials(Component="BH.oM.Twitter.Credentials")
panel = Panel("https://api.twitter.com/1.1/tweets/search/fullarchive/full.json")
authenticateapplication = AuthenticateApplication(Credentials=credentials_2, Component="{ .AuthenticateApplication")
searchparameters = SearchParameters(
    Query="-is:retweet Liverpool Anfield lang:en",
    MaxResults=Slider(10, range=0..10),
    Component="BH.oM.Twitter.SearchParameters")
searchtweets_2 = SearchTweets(Application=authenticateapplication, Endpoint=panel, SearchParameters=searchparameters, Component="{ .SearchTweets")
explode_4 = Explode(Object=searchtweets_2, Component="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")  # -> Results, BHoM_Guid, Name, Fragments, Tags, CustomData
explode_5 = Explode(Object=explode_4.Results, Component="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")  # -> Objects, Name, Tags, BHoM_Guid
explode_6 = Explode(Object=explode_5.Objects, Component="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")  # -> Created_at, Id, Id_str, Text, Display_text_range, Source, Truncated, In_reply_to_status_id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

panel_2 = Panel(explode_3.Id)
panel_3 = Panel(explode_6.Text)
